# Dynamo graph CreateContainer.dyn (Dynamo 0.8.2.2392)

# group: Curvature
select_edge = DSEdgeSelection()  # 1 picked in the model
normal = Curve.Normal(select_edge)
select_edge_2 = DSEdgeSelection()  # 1 picked in the model
normal_2 = Curve.Normal(select_edge_2)

# group: Host Element
select_model_element = DSModelElementSelection()  # 1 picked in the model
id = Element.Id(select_model_element)

# group: Rebar Options
rebar_style = RebarStyle("Standard")
rebar_bar_type = RebarBarType("#10")
rebar_hook_orientation = RebarHookOrientation("Left")
rebar_hook_type = RevitRebarHookType("Rebar Hook 90")

byCurve = Rebar.ByCurve(select_edge, id, rebar_style, rebar_bar_type, rebar_hook_orientation, rebar_hook_orientation, rebar_hook_type, rebar_hook_type, normal)
byCurve_2 = Rebar.ByCurve(select_edge_2, id, rebar_style, rebar_bar_type, rebar_hook_orientation, rebar_hook_orientation, rebar_hook_type, rebar_hook_type, normal_2)

# group: Create a Container
create = List.Create(byCurve, byCurve_2)
byBars = RebarContainer.ByBars(create)

watch = Watch(create)
