# Dynamo graph Cut.dyn (Dynamo 0.8.2.2392)

# group: Curvature
select_face = DSFaceSelection()  # 1 picked in the model
number = DoubleInput(4)
boolean = BoolSelector(false)
number_2 = DoubleInput(500)
boolean_2 = BoolSelector(true)
followingSurface = DynamoRebar.Rebar.FollowingSurface(select_face, number, arg3=boolean, arg4=number_2, arg5=boolean_2)

# group: Host Element
select_model_element = DSModelElementSelection()  # 1 picked in the model
id = Element.Id(select_model_element)

# group: Rebar Options
rebar_style = RebarStyle("Standard")
rebar_bar_type = RebarBarType("#10")
rebar_hook_orientation = RebarHookOrientation("Left")
rebar_hook_type = RevitRebarHookType("Standard - 180 deg.")

ZAxis = Vector.ZAxis()
byCurve = RebarContainer.ByCurve(followingSurface, id, rebar_style, rebar_bar_type, rebar_hook_orientation, rebar_hook_orientation, rebar_hook_type, rebar_hook_type, ZAxis)

# group: Cut Operation
select_face_2 = DSFaceSelection()  # 1 picked in the model
boolean_3 = BoolSelector(true)
cut = DynamoRebar.Rebar.Cut(select_face_2, byCurve, boolean_3)
