# Dynamo graph Generic Foundation.dyn (Dynamo 0.9.1.2992)

# group: Rebar Type
rebar_hook_type = RevitRebarHookType("None")
rebar_bar_type = RebarBarType("10 220S")
rebar_hook_orientation = RebarHookOrientation("Left")

# group: Stirrup Settings
rebar_bar_type_2 = RebarBarType("10 220S")
rebar_hook_orientation_2 = RebarHookOrientation("Left")
rebar_hook_type_2 = RevitRebarHookType("Standard - 90 deg.")

# group: Geometry Selection
select_face = DSFaceSelection()  # 1 picked in the model
select_face_2 = DSFaceSelection()  # 1 picked in the model
select_model_element = DSModelElementSelection()  # 1 picked in the model

# group: Bar Distribution
cover_parameter = DoubleInput(200)
division = DoubleInput(4)

# group: Stirrup Distribution
stirrup_gap = DoubleInput(200)
stirrup_distance = DoubleInput(300)

# group: Bottom Hook Settings
bottom_hook_length = DoubleInput(500)
bottom_hook_bending_radius = DoubleInput(300)

foundation_rebar = Custom[Foundation Rebar](Start_Rebar_Hook_Type=rebar_hook_type, End_Rebar_Hook_Type=rebar_hook_type, Rebar_Bar_Type=rebar_bar_type, Rebar_Hook_Orientation=rebar_hook_orientation, Stirrup_Bar_Type=rebar_bar_type_2, Stirrup_Hook_Orientation=rebar_hook_orientation_2, Stirrup_Hook_Type=rebar_hook_type_2, Bottom_Face=select_face, Top_Face=select_face_2, Cover=cover_parameter, Divisions=division, Parent_Element=select_model_element, Stirrup_Overlap=stirrup_gap, Bottom_Hook_Length=bottom_hook_length, Bottom_bending_radius=bottom_hook_bending_radius, Stirrup_Stepping=stirrup_distance)  # Standard Rebar for Foundations
