# Dynamo graph MaterialProperties.dyn (Dynamo 0.9.0.3067)

select_model_element = DSModelElementSelection()  # 1 picked in the model
boolean = BoolSelector(false)
getMaterialNames = DynamoRebar.Rebar.GetMaterialNames(select_model_element, boolean)
getMaterialProperties = DynamoRebar.Rebar.GetMaterialProperties(getMaterialNames)
getParameterNameAndValue = DynamoRebar.Rebar.GetParameterNameAndValue(getMaterialProperties.out13)
getParameterNameAndValue_2 = DynamoRebar.Rebar.GetParameterNameAndValue(getMaterialProperties.out9)
getParameterNameAndValue_3 = DynamoRebar.Rebar.GetParameterNameAndValue(getMaterialProperties.out11)
watch = Watch(getParameterNameAndValue_3.out0)
watch_2 = Watch(getParameterNameAndValue_3.out1)
