# Dynamo graph Morphed.dyn (Dynamo 0.9.0.3067)

# group: Curvature
select_edge = DSEdgeSelection()  # 1 picked in the model
select_edge_2 = DSEdgeSelection()  # 1 picked in the model
number = DoubleInput(5)
morphed = DynamoRebar.Rebar.Morphed(select_edge, select_edge_2, number)

# group: Host Element
select_model_element = DSModelElementSelection()  # 1 picked in the model
id = Element.Id(select_model_element)

# group: Rebar Options
rebar_style = RebarStyle("Standard")
rebar_bar_type = RebarBarType("#10")
rebar_hook_orientation = RebarHookOrientation("Left")
rebar_hook_type = RevitRebarHookType("Rebar Hook 90")

ZAxis = Vector.ZAxis()
byCurve = RebarContainer.ByCurve(morphed, id, rebar_style, rebar_bar_type, rebar_hook_orientation, rebar_hook_orientation, rebar_hook_type, rebar_hook_type, ZAxis)
