# Dynamo graph Perpendicular.dyn (Dynamo 0.8.2.2392)

# group: Curvature
select_face = DSFaceSelection()  # 1 picked in the model
select_faces = SelectFaces()  # 5 picked in the model
flatten = Flatten(select_faces)
number = DoubleInput(0.5)
number_2 = DoubleInput(6)
boolean = BoolSelector(false)
perpendicular = DynamoRebar.Rebar.Perpendicular(select_face, flatten, number, number_2, boolean)

# group: Host Element
select_model_element = DSModelElementSelection()  # 1 picked in the model
id = Element.Id(select_model_element)

# group: Rebar Options
rebar_style = RebarStyle("Standard")
rebar_bar_type = RebarBarType("#11")
rebar_hook_orientation = RebarHookOrientation("Right")
rebar_hook_type = RevitRebarHookType("Rebar Hook 90")

ZAxis = Vector.ZAxis()
byCurve = RebarContainer.ByCurve(perpendicular, id, rebar_style, rebar_bar_type, rebar_hook_orientation, rebar_hook_orientation, rebar_hook_type, rebar_hook_type, ZAxis)
