# Dynamo graph SimpleLine.dyn (Dynamo 0.8.2.2392)

# group: Curvature
byCoordinates = Point.ByCoordinates()
number = DoubleInput(3000)
byCoordinates_2 = Point.ByCoordinates(y=number, z=number)
byStartPointEndPoint = Line.ByStartPointEndPoint(startPoint=byCoordinates, endPoint=byCoordinates_2)
normal = Curve.Normal(byStartPointEndPoint)

# group: Element
select_model_element = DSModelElementSelection()  # 1 picked in the model
id = Element.Id(select_model_element)

# group: Rebar options
rebar_style = RebarStyle("Standard")
rebar_bar_type = RebarBarType("10 220S")
rebar_hook_orientation = RebarHookOrientation("Left")
rebar_hook_type = RevitRebarHookType("Standard - 135 deg.")

boolean = BoolSelector(true)
byCurve = Rebar.ByCurve(byStartPointEndPoint, id, rebar_style, rebar_bar_type, rebar_hook_orientation, rebar_hook_orientation, rebar_hook_type, rebar_hook_type, normal, boolean)
