# Dynamo graph Stirrup.dyn (Dynamo 0.9.0.3067)

select_face = DSFaceSelection()
number = DoubleInput(5)
boolean = BoolSelector(true)
number_2 = DoubleInput(-300)
followingSurface = DynamoRebar.Rebar.FollowingSurface(select_face, number, arg3=boolean, arg4=number_2)
flatten = Flatten(followingSurface)

# group: Host Element
select_model_element = DSModelElementSelection()
id = Element.Id(select_model_element)

# group: Rebar Options
rebar_style = RebarStyle("Standard")
rebar_bar_type = RebarBarType("#10")
rebar_hook_orientation = RebarHookOrientation("Left")
rebar_hook_type = RevitRebarHookType("Rebar Hook 90")

ZAxis = Vector.ZAxis()
byCurve = RebarContainer.ByCurve(flatten, id, rebar_style, rebar_bar_type, rebar_hook_orientation, rebar_hook_orientation, rebar_hook_type, rebar_hook_type, ZAxis)
select_face_2 = DSFaceSelection()
flatten_2 = Flatten(select_face_2)
solids = Element.Solids(select_model_element)
intersect = Geometry.Intersect(geometry=flatten_2, other=solids)
flatten_3 = Flatten(intersect)
perimeterCurves = Surface.PerimeterCurves(flatten_3)
flatten_4 = Flatten(perimeterCurves)
number_3 = DoubleInput(0)
removeItemAtIndex = List.RemoveItemAtIndex(list=flatten_4, indices=number_3)
byJoinedCurves = PolyCurve.ByJoinedCurves(removeItemAtIndex)
number_4 = DoubleInput(400)
fillet = PolyCurve.Fillet(byJoinedCurves, number_4)

# group: Rebar Options
rebar_style_2 = RebarStyle("Standard")
rebar_bar_type_2 = RebarBarType("#10")
rebar_hook_orientation_2 = RebarHookOrientation("Left")
rebar_hook_type_2 = RevitRebarHookType("Rebar Hook 90")

normalAtParameter = Surface.NormalAtParameter(surface=select_face_2)
byCurve_2 = Rebar.ByCurve(fillet, id, rebar_style_2, rebar_bar_type_2, rebar_hook_orientation_2, rebar_hook_orientation_2, rebar_hook_type_2, rebar_hook_type_2, normalAtParameter)
watch = Watch(fillet)
