# Dynamo graph TagElements.dyn (Dynamo 0.9.1.2992)

# group: Views
views = Views("L01-T/SLAB")

# group: Select Elements
select_model_elements = DSModelElementsSelection()  # 2 picked in the model

boolean = BoolSelector(false)

# group: Location
location = StructuralFraming.Location(select_model_elements)
endPoint = Curve.EndPoint(location)

byElement = Tag.ByElement(views, select_model_elements, boolean, boolean, endPoint, boolean)

# group: Offset from MidPoint
code_block = CodeBlock { 900; }
byCoordinates = Point.ByCoordinates(y=code_block)
boolean_2 = BoolSelector(true)

byElement_2 = Tag.ByElement(views, select_model_elements, boolean, boolean, byCoordinates, boolean_2)
