# Dynamo graph DynamoWorkspace.dyn (Dynamo 0.8.0.950)

select_model_element = DSModelElementSelection()  # 1 picked in the model
id = Element.Id(select_model_element)
select_face = DSFaceSelection()  # 1 picked in the model
number = DoubleInput(4)
boolean = BoolSelector(false)
number_2 = DoubleInput(500)
followingSurface = Rebar.FollowingSurface(select_face, number, arg3=boolean, arg4=number_2)
select_model_element_2 = DSModelElementSelection()  # 1 picked in the model
id_2 = Element.Id(select_model_element_2)
rebar_style = RebarStyle("Standard")
rebar_bar_type = RebarBarType("#6")
rebar_hook_orientation = RebarHookOrientation("Right")
rebar_hook_type = RevitRebarHookType("Standard - 90 deg.")
byCurve = RebarContainer.ByCurve(followingSurface, id_2, rebar_style, rebar_bar_type, rebar_hook_orientation, rebar_hook_orientation, rebar_hook_type, rebar_hook_type)
ZAxis = Vector.ZAxis()
select_face_2 = DSFaceSelection()  # 1 picked in the model
select_faces = SelectFaces()  # 5 picked in the model
flatten = Flatten(select_faces)
number_3 = DoubleInput(0.5)
number_4 = DoubleInput(20)
boolean_2 = BoolSelector(true)
number_5 = DoubleInput(500)
perpendicular = Rebar.Perpendicular(select_face_2, flatten, number_3, number_4, boolean_2, number_5)
flatten_2 = Flatten(perpendicular)
byCurve_2 = RebarContainer.ByCurve(flatten_2, id_2, rebar_style, rebar_bar_type, rebar_hook_orientation, rebar_hook_orientation, rebar_hook_type, rebar_hook_type)
select_edge = DSEdgeSelection()  # 1 picked in the model
select_edge_2 = DSEdgeSelection()  # 1 picked in the model
number_6 = DoubleInput(10)
morphed = Rebar.Morphed(select_edge, select_edge_2, number_6)
byCurve_3 = RebarContainer.ByCurve(morphed, id_2, rebar_style, rebar_bar_type, rebar_hook_orientation, rebar_hook_orientation, rebar_hook_type, rebar_hook_type)
boolean_3 = BoolSelector(true)
boolean_4 = BoolSelector(true)
flatten_3 = Flatten(followingSurface)
firstItem = List.FirstItem(flatten_3)
byCurve_4 = Rebar.ByCurve(firstItem, id_2, rebar_style, rebar_bar_type, rebar_hook_orientation, rebar_hook_orientation, rebar_hook_type, rebar_hook_type)
boolean_5 = BoolSelector(true)
boolean_6 = BoolSelector(true)
select_face_3 = DSFaceSelection()  # 1 picked in the model
select_edge_3 = DSEdgeSelection()  # 1 picked in the model
select_edge_4 = DSEdgeSelection()  # 1 picked in the model
morphed_2 = Rebar.Morphed(select_edge_3, select_edge_4, number_6)
byCurve_5 = RebarContainer.ByCurve(morphed_2, id_2, rebar_style, rebar_bar_type, rebar_hook_orientation, rebar_hook_orientation, rebar_hook_type, rebar_hook_type)
cut = Rebar.Cut(select_face_3, byCurve_5)
byElement = Tag.ByElement()
shorten = Rebar.Shorten(morphed_2, number_5)
number_7 = DoubleInput(0.3)
perpendicular_2 = Rebar.Perpendicular(select_face_2, flatten, number_7, number_4, boolean_2, number_5)
flatten_4 = Flatten(perpendicular_2)
byCurve_6 = RebarContainer.ByCurve(flatten_4, id_2, rebar_style, rebar_bar_type, rebar_hook_orientation, rebar_hook_orientation, rebar_hook_type, rebar_hook_type)
select_edge_5 = DSEdgeSelection()  # 1 picked in the model
select_edge_6 = DSEdgeSelection()  # 1 picked in the model
morphed_3 = Rebar.Morphed(select_edge_5, select_edge_6, number_6)
byCurve_7 = RebarContainer.ByCurve(morphed_3, id_2, rebar_style, rebar_bar_type, rebar_hook_orientation, rebar_hook_orientation, rebar_hook_type, rebar_hook_type)
shorten_2 = Rebar.Shorten()
